# Grasshopper definition harvester.gh (Grasshopper 1.0.7)
# Copyright: 2019

# David Rutten:
# https://discourse.mcneel.com/t/scraping-components-names-inputs-and-outputs-from-an-addin/106160/3
list = ValueList({"Grasshopper", "Math Components", "Curve Components", "Topologic": "TopologicGH"}, selected="Topologic")
c_script = CSharpScript(Plugin=list)  # -> out, Components; inputs Plugin: String
# ---------- c_script: C# ----------
    var results = new List<string>();

    foreach (IGH_ObjectProxy proxy in Grasshopper.Instances.ComponentServer.ObjectProxies)
    {
      var plugin = Grasshopper.Instances.ComponentServer.FindAssembly(proxy.LibraryGuid);
      if (plugin == null)
        continue;

      if (!string.Equals(plugin.Name, Plugin, StringComparison.OrdinalIgnoreCase))
        continue;

      var obj = proxy.CreateInstance();
      var cmp = obj as IGH_Component;

      if (cmp == null)
        continue;

      var args = new List<string>();

      foreach (IGH_Param input in cmp.Params.Input)
        args.Add(string.Format("{0} {1}", input.TypeName, input.NickName));

      foreach (IGH_Param output in cmp.Params.Output)
        args.Add(string.Format("out {0} {1}", output.TypeName, output.NickName));

      results.Add(string.Format("{0}({1})", cmp.Name, string.Join(", ", args)));
    }

    Components = results;
# ---------- end c_script ----------
panel = Panel(c_script.Components)
